vi "Main Window.gvi"   [LabVIEW NXG 5.0.0]
panel controls:
  "Acquire Button": bool
  "Load Measurement": bool
  "Save Measurement": bool
  "IV Curve Parameters": "IV Curve Parameters.gtype"
  "Cell Selector": "Cell Selector.gtype"
  "Main Tab": i32
  "Custom date": bool
  "Author Initials": string
  "Batch Name": string
  "Cell Number": string
  "Sample Comments": string
  "Abort Button": bool
  "Exit App Button": bool
  "Add Layer Button": bool
  "Add Layer Button_2": bool
  "Add Layer Button_3": bool
  "Queue In": Queue<"Queue Instructions Control.gtype">
  "Label Info Error Label": string
  "Label Info Missing Error": bool
  "Config Tab": i32
  "Misc Data Mega Cluster": "Misc Mega Cluster.gtype"
  "Instrument Control Mega Cluster": "Instrument Control Mega Cluster.gtype"
  "Desired Cell": "Cell Selector.gtype" = "L.01"
  "Set Cell": bool
  "Cell Parameters": "Cell Parameters.gtype" = {"Max (V)"=1, "Min (V)"=-0.2, "Sweep Dir"=FALSE, "Curr Range (A)"=0.1, "Autorange"=TRUE, "Max (A)"=1, "Cell Area (m^2)"=8e-06, "Light Power (W m^-2)"=1000}
  "IV Mode": "IV Mode.gtype" = "Rough"
  "Measurement Precision": "Accuracy Parameters.gtype" = {"V Points"=100, "Current Avg"=3, "Integration Time"=0.5, "Iterations"=1}
  "Default Data Saving Location": path
panel indicators:
  "Current Date": string
  "Progress %": f64
  "State": string
  "Substate": string
  "Sample Prefix": string
  "Progress counter": f64
  "Layer Information": string[]
  "Live IV Parameters": "Live IV Parameters.gtype"
  "Queue Out": Queue<"Queue Instructions Control.gtype">
  "JV Main Graph": f64[]
  "Current State": "Queue Instructions Control.gtype"
  "Elapsed Time (kr)": f64
  "Estimated Time (kr)": f64
types:
  "Cell Parameters.gtype" = cluster{"Max (V)": f64, "Min (V)": f64, "Sweep Dir": bool, "Curr Range (A)": f64, "Autorange": bool, "Max (A)": f64, "Cell Area (m^2)": f64, "Light Power (W m^-2)": f64}
  "Accuracy Parameters.gtype" = cluster{"V Points": u32, "Current Avg": u32, "Integration Time": f64, "Iterations": u32, "Rs Rsh Slope points": u32}
  "IV Mode.gtype" = enum{"Rough", "Normal", "Accurate", "Smart", "Custom"}
  "IV Curve Parameters.gtype" = cluster{"Cell Parameters": "Cell Parameters.gtype", "Measurement Precision": "Accuracy Parameters.gtype", "IV Accuracy Mode": "IV Mode.gtype"}
  T1 = cluster{"L.01": bool, "R.01": bool, "L.02": bool, "R.02": bool, "L.03": bool, "R.03": bool, "L.04": bool, "R.04": bool, "L.05": bool, "R.05": bool, "L.06": bool, "R.06": bool, "L.07": bool, "R.07": bool, "L.08": bool, "R.08": bool, "L.09": bool, "R.09": bool, "L.10": bool, "R.10": bool, "L.11": bool, "R.11": bool, "L.12": bool, "R.12": bool}
  "Cell Selector.gtype" = cluster{"All": bool, "Left": bool, "Right": bool, "Cell Cluster": T1, "Reset": bool, "Random Order ": bool, "Continuous Cell": bool}
  "Live IV Parameters.gtype" = cluster{"Current (A)": f64, "Voltage (V)": f64, "Current Density (A/m^2)": f64, "Current Cell": enum{""}}
  "Queue Instructions Control.gtype" = enum{"Undefined State", "Debug Check", "Initialize App", "Idle", "Change Cell", "IV Curves Acquisition", "Saving TXT Files", "Generating Origin Files", "Stopping App", "State 1", "State2", "State3", "State4", "State5"}
  "Full Reference Cluster.gtype" = cluster{"Sample Extra Information": "Sample extra imformation.gtype", "Acquisition Parameters": "Acquisition Parameters.gtype", "Status Report": "Status Report.gtype", "Live Progress": "Live Progress.gtype", "Sample Naming Cluster": "Sample Naming Cluster.gtype", "Path Cluster": "Path Cluster.gtype"}
  "Misc Mega Cluster.gtype" = cluster{"Full Reference Cluster": "Full Reference Cluster.gtype"}
  T2 = cluster{"Element 1": "VISA Instr", "Element 2": string}
  T3 = enum{"Keithley 2400 Series", "Keithley 2450 Series"}
  "Instrument Control.gtype" = cluster{"Multiplexer Arduino Detected?": bool, "Multiplexer Arduino Address": "VISA Instr", "Arduinos List": T2[], "Multiplexer Log": string, "Keythley Address": "VISA Instr", "Keithley Detected?": bool, "Keithley ID": string, "Detected Keithley Type": T3}
  "Debugging Cluster.gtype" = cluster{"Debugging mode?": bool, "Initialize App": bool, "Insturment Debugging": cluster{"Keithley": bool, "Arduino": bool}}
  "Instrument Control Mega Cluster.gtype" = cluster{"Instrument Control": "Instrument Control.gtype", "Debugging Cluster": "Debugging Cluster.gtype"}
  "Acquisition Parameters.gtype" = cluster{"Cell Selector": "Cluster reference", "Cell Parameters Ref": "Cluster reference", "IV Mode Ref": "EnumSelector reference", "Measurement Precision Ref": "Cluster reference"}
  "Sample Naming Cluster.gtype" = cluster{"Author Initials": "ComboBoxSelector reference", "Batch Name": "StringControl reference", "Cell Number": "StringControl reference", "Current Date": "StringControl reference", "Sample Comments": "StringControl reference", "Sample Prefix": "StringControl reference", "Custom Date": "CheckBox reference", "Label Info Error Label Ref": "StringControl reference", "Label Info Missing Error Ref": "BooleanControl reference"}
  "Path Cluster.gtype" = cluster{"Default Data Saving Location ref": "PathSelector reference"}
  "Status Report.gtype" = cluster{"State": "StringControl reference", "Substate": "StringControl reference", "Current State Ref": "EnumSelector reference", "Main Tab Reference": "TabControl reference"}
  "Live Progress.gtype" = cluster{"Progress %": "ProgressBar reference", "Progress Counter": "NumericTextBoxDouble reference", "Live IV Parameters Ref": "Cluster reference"}
  "Sample extra imformation.gtype" = cluster{"Layer Information": "ArrayViewer reference"[]}
uses:
  Pika IV Characterization NXG::Side Functions::Abort Control::FGV Global Abort.gvi
  Pika IV Characterization NXG::Main Functions::Instruction Handling::FGV Current State.gvi
  Pika IV Characterization NXG::Side Functions::Timeout::FGV Progress.gvi
  Pika IV Characterization NXG::Side Functions::Timeout::Timeout Subroutine.gvi
  Pika IV Characterization NXG::Side Functions::Exit App Sequence.gvi
  Pika IV Characterization NXG::Side Functions::Utilities::Cell Naming::Sample Naming Subroutine.gvi
  Pika IV Characterization NXG::Side Functions::Utilities::Cell Naming::FGV Sample Prefix.gvi
  Pika IV Characterization NXG::Main Functions::Instruction Handling::Check Queue And Label.gvi
  Pika IV Characterization NXG::Main Functions::Instruction Handling::Condition Enqueue.gvi
  Pika IV Characterization NXG::Main Functions::IV Curves::IV Operation Translation.gvi
  Pika IV Characterization NXG::Side Functions::Instrument Control::Arduino Multiplexer::Set Cell Requisites.gvi
  NI::G Core::Error::Is Error.gvi
  Pika IV Characterization NXG::Side Functions::Abort Control::Abort Sequence.gvi
  Pika IV Characterization NXG::Side Functions::Debugging::Debugging Prompt.gvi
  Pika IV Characterization NXG::Main Functions::Initializing App::Initialize App Subroutine.gvi
  Pika IV Characterization NXG::Side Functions::Instrument Control::Arduino Multiplexer::Set Cell Subroutine.gvi
  NI::G Core::Error::Multiplex Errors.gvi
  NI::G Core::Error::Display Error.gvi
diagram:
  case (TRUE) {
    frame False, Default {
      w1 = default
    }
    frame True {
      Property Node(instance in="Acquisition Parameters.gtype" {all zero or empty}, "Cell Selector"=reference to "Cell Selector", "Measurement Precision Ref"=reference to "Measurement Precision", "Cell Parameters Ref"=reference to "Cell Parameters", "IV Mode Ref"=reference to "IV Mode") -> (instance out=w2)
      Property Node(instance in="Sample Naming Cluster.gtype" {all zero or empty}, "Author Initials"=reference to "Author Initials", "Batch Name"=reference to "Batch Name", "Cell Number"=reference to "Cell Number", "Current Date"=reference to "Current Date", "Sample Comments"=reference to "Sample Comments", "Sample Prefix"=reference to "Sample Prefix", "Custom Date"=reference to "Custom date", "Label Info Error Label Ref"=reference to "Label Info Error Label", "Label Info Missing Error Ref"=reference to "Label Info Missing Error") -> (instance out=w3)
      Property Node(instance in="Path Cluster.gtype" {all zero or empty}, "Default Data Saving Location ref"=reference to "Default Data Saving Location") -> (instance out=w4)
      Property Node(instance in="Status Report.gtype" {all zero or empty}, "State"=reference to "State", "Substate"=reference to "Substate", "Current State Ref"=reference to "Current State", "Main Tab Reference"=reference to "Main Tab") -> (instance out=w5)
      Property Node(instance in="Live Progress.gtype" {all zero or empty}, "Progress %"=reference to "Progress %", "Progress Counter"=reference to "Progress counter", "Live IV Parameters Ref"=reference to "Live IV Parameters") -> (instance out=w6)
      Property Node(instance in="Sample extra imformation.gtype" {all zero or empty}, "Layer Information"=reference to "Layer Information") -> (instance out=w7)
      Property Node(instance in="Full Reference Cluster.gtype" {all zero or empty}, "Sample Extra Information"=w7, "Acquisition Parameters"=w2, "Status Report"=w5, "Live Progress"=w6, "Sample Naming Cluster"=w3, "Path Cluster"=w4)
      w1 = no error
    }
  }
  call "FGV Global Abort.gvi"(Global Abort Instructions="Reset State", Error In=w1) -> (Error Out=w8)
  call "FGV Current State.gvi"(Current State Instructions="Set Current State and Substate", Current State="Undefined State", Current Substate="Starting Up", Error In=w8) -> (Error Out=w9)
  Obtain Queue(create if not found=TRUE, element data type="Queue Instructions Control.gtype" "Undefined State", error in=w9, name="Instruction Queue") -> (error out=w10, queue out=w11)
  Enqueue Element(element="Debug Check", error in=w10, queue=w11) -> (error out=w12, queue out=w13)
  s1 = w13  # shift register
  while {
    event (timeout = 50) {
      on "Timeout" {
        call "FGV Progress.gvi"(FGV Instructions="Read State", Error In=w12) -> (Progress Out=w17, Elapsed Time Out (kr)=w18, Estimated Time Out (kr)=w19, Error Out=w20)
        $"Progress %" <- w17
        $"Progress counter" <- w17
        $"Estimated Time (kr)" <- w19
        call "Timeout Subroutine.gvi"(Queue In=s1, Misc Data Mega Cluster In=$"Misc Data Mega Cluster", Error In=w20) -> (Queue Out=w15, Misc Data Mega Cluster Out=w21, Stop App?=w16, Error Out=w14)
        $"Misc Data Mega Cluster" <- w21
        $"Elapsed Time (kr)" <- w18
      }
      on "Exit App Button" Value changed {
        call "Exit App Sequence.gvi"(Queue In=s1, Exit App=$"Exit App Button", Error In=w12) -> (Queue Out=w15, Error Out=w14)
        w16 = default
      }
      on "Author Initials" Value changed; "Batch Name" Value changed; "Cell Number" Value changed; "Current Date" Value changed; "Custom date" Value changed; "Sample Comments" Value changed; "Sample Prefix" Value changed {
        call "Sample Naming Subroutine.gvi"(Misc Data Mega Cluster In=$"Misc Data Mega Cluster", Error In=w12) -> (Misc Data Mega Cluster Out=w22, Error Out=w23)
        $"Misc Data Mega Cluster" <- w22
        call "FGV Sample Prefix.gvi"(FGV Instructions="Set State", Misc Mega Cluster=w22, Error In=w23) -> (Error Out=w14)
        w15 = default
        w16 = default
      }
      on "Acquire Button" Value changed; "Save Measurement" Value changed {
        call "Check Queue And Label.gvi"(Label Info Error Label=$"Label Info Error Label", Label Info Missing Error=$"Label Info Missing Error", Error In=w12, Is Label Necessary?=TRUE) -> (Proceed to enqueue=w24, Error Out=w25)
        call "Condition Enqueue.gvi"(Queue In=s1, Queue Instruction="IV Curves Acquisition", Error In=w25, Equeue?=w24) -> (Queue Out=w15, Error Out=w26)
        call "IV Operation Translation.gvi"(Acquire Button=$"Acquire Button", Load Measurement=FALSE, Save Measurement=$"Save Measurement", Error In=w26) -> (Error Out=w14)
        w16 = default
      }
      on "Load Measurement" Value changed {
        call "Check Queue And Label.gvi"(Label Info Error Label=$"Label Info Error Label", Label Info Missing Error=$"Label Info Missing Error", Error In=w12, Is Label Necessary?=TRUE) -> (Proceed to enqueue=w27, Error Out=w28)
        call "Condition Enqueue.gvi"(Queue In=s1, Queue Instruction="IV Curves Acquisition", Error In=w28, Equeue?=w27) -> (Queue Out=w15, Error Out=w29)
        call "IV Operation Translation.gvi"(Acquire Button=FALSE, Load Measurement=$"Load Measurement", Save Measurement=FALSE, Error In=w29) -> (Error Out=w14)
        w16 = default
      }
      on "Set Cell" Value changed {
        call "Set Cell Requisites.gvi"(Queue In=s1, Instrument Control Mega Cluster=$"Instrument Control Mega Cluster", Error In=w12, Set Cell=$"Set Cell") -> (Queue Out=w15, Error Out=w14)
        w16 = default
      }
    }
    call "Is Error.gvi"(error in=w14) -> (error?=w30)
    Logical Or(w30, w16) -> w31
    next s1 = w15
    stop if w31
  }
  s2 = w13  # shift register
  s3 = w12  # shift register
  while {
    event (timeout = 100) {
      on "Timeout" {
        call "FGV Global Abort.gvi"(Global Abort Instructions="Read Current State", Error In=s3) -> (Global Abort Out=w35, Error Out=w36)
        Preview Queue Element(error in=w36, queue=s2, timeout in ms=100) -> (element=w37, error out=w32, queue out=w33)
        Is Equal(x=w37, y="Stopping App") -> w38
        Logical Or(w38, w35) -> w34
      }
      on "Abort Button" Value changed {
        call "Abort Sequence.gvi"(Queue In=s2, Global Abort=$"Abort Button", Error In=s3) -> (Queue Out=w33, Error Out=w32)
        w34 = default
      }
    }
    next s2 = w33
    next s3 = w32
    stop if w34
  }
  Enqueue Element(element="Stopping App", error in=s3, queue=s2) -> (error out=w39)
  s4 = w13  # shift register
  while {
    Dequeue Element(error in=w12, queue=s4) -> (element=w40, error out=w41, queue out=w42)
    case (w40) {
      frame "Undefined State", Default {
        w43 = w41
        w44 = w42
        w45 = default
      }
      frame "Debug Check" {
        call "Debugging Prompt.gvi"(Instrument Control Mega Cluster In=$"Instrument Control Mega Cluster", Error In=w41) -> (Instrument Control Mega Cluster Out=w46, Error Out=w47)
        Enqueue Element(element="Initialize App", error in=w47, queue=w42) -> (error out=w43, queue out=w44)
        $"Instrument Control Mega Cluster" <- w46
        w45 = default
      }
      frame "Initialize App" {
        call "Initialize App Subroutine.gvi"(Instrument Control Mega Cluster In=$"Instrument Control Mega Cluster", Misc Data Mega Cluster In=$"Misc Data Mega Cluster", Error In=w41) -> (Instrument Control Mega Cluster Out=w48, Misc Data Mega Cluster Out=w49, Error Out=w50)
        $"Instrument Control Mega Cluster" <- w48
        $"Misc Data Mega Cluster" <- w49
        Enqueue Element(element="Idle", error in=w50, queue=w42) -> (error out=w43, queue out=w44)
        w45 = default
      }
      frame "Idle" {
        call "FGV Global Abort.gvi"(Global Abort Instructions="Reset Local", Error In=w41) -> (Error Out=w51)
        call "FGV Current State.gvi"(Current State Instructions="Set Current State and Substate", Current State="Idle", Current Substate="Idle", Error In=w51) -> (Error Out=w52)
        call "FGV Progress.gvi"(FGV Instructions="Reset State", Error In=w52) -> (Error Out=w43)
        w44 = w42
        w45 = default
      }
      frame "Change Cell" {
        call "Set Cell Subroutine.gvi"(Instrument Control Mega Cluster In=$"Instrument Control Mega Cluster", Error In=w41) -> (Instrument Control Mega Cluster Out=w53, Error Out=w54)
        Enqueue Element(element="Idle", error in=w54, queue=w42) -> (error out=w43, queue out=w44)
        $"Instrument Control Mega Cluster" <- w53
        w45 = default
      }
      frame "Stopping App" {
        call "FGV Current State.gvi"(Current State Instructions="Set Current State and Substate", Current State="Stopping App", Current Substate="Bye Bye :D", Error In=w41) -> (Error Out=w43)
        w44 = w42
        w45 = TRUE
      }
    }
    call "Is Error.gvi"(error in=w43) -> (error?=w55)
    Logical Or(w55, w45) -> w56
    call "FGV Global Abort.gvi"(Global Abort Instructions="Reset State", Global Abort=w56, Error In=w43) -> (Error Out=w57)
    next s4 = w44
    stop if w56
  }
  Enqueue Element(element="Stopping App", error in=w57, queue=s4) -> (error out=w58)
  call "Multiplex Errors.gvi"(error in 1=w14, error in 2=w58, error in 3=w39) -> (error out=w59)
  Flush Queue(error in=w59, queue=s1) -> (error out=w60, queue out=w61)
  Release Queue(error in=w60, queue=w61) -> (error out=w62)
  case (w62) {
    frame Error, Default {
      # In case there is an error
      # put out an error handler
      call "Display Error.gvi"(error in=w62)
    }
    frame No Error { }
  }
